# Grasshopper definition bitstrings.gh (Grasshopper 0.9.76)
# plug-ins: Human

# (mirrorX
#     (diff
#      (mirrorZ (mirrorX (mirrorY (mirrorX a))))
#      (union
#       (translateY+ (union (translateZ+ a) a))
#       (union
#        (translateZ+ (translateY+ a))
#        (union (translateZ+ a) (translateX+ a)))))))
# (union
#     (translateZ+
#      (union
#       (union
#        (union
#         (translateZ+ (translateZ+ (translateY- (translateZ+ a))))
#         (translateY+ (translateZ+ (translateX- (translateZ+ a)))))
#        (union
#         (union
#          (translateY+ (translateX+ (translateX+ a)))
#          (translateY+ (translateY+ (translateX+ a))))
#         (union
#          (translateY+ (translateX+ (translateX+ a)))
#          (union (translateZ+ (translateZ+ a)) (translateY+ (translateX+ a))))))
#       (union
#        (translateZ+
#         (translateX+
#          (union (translateX+ (translateY+ a)) (translateY+ (translateY+ a)))))
#        (translateZ+
#         (translateY- (translateX- (translateX- (translateZ+ a))))))))
#     (diff
#      (union
#       (union
#        (translateZ+ (translateZ+ (translateX- (translateZ+ (translateZ+ a)))))
#        (union
#         (union
#          (translateX- (union (translateZ+ a) (translateY+ a)))
#          (union (translateY- (translateZ+ a)) (diff (translateY+ a) a)))
#         (translateY+ (translateY+ (translateX- (translateZ+ a))))))
#       a)
#      (diff
#       (union
#        (translateY+
#         (union
#          (translateZ+ (translateX- (translateY+ a)))
#          (union (translateX+ (translateX+ a)) (union a (translateY+ a)))))
#        (union
#         (translateZ- (translateZ+ (translateY+ (translateY+ a))))
#         (translateZ+ (translateY+ (translateX+ (translateX+ a))))))
#       (translateY-
#        (translateZ+
#         (translateY+ (translateY+ (translateX- (translateZ+ a)))))))))
panel = Panel("(mirrorZ (mirrorX (mirrorY (mirrorX a))))")
# (union
#     (translateY-
#      (union
#       (union
#        (translateY+ (translateZ+ (translateZ+ (translateY+ (translateZ+ a)))))
#        (union
#         (translateY+ (translateZ+ (translateX+ (translateX+ a))))
#         (translateY-
#          (union (translateY- (translateZ+ a)) (translateX- (translateZ+ a))))))
#       (union
#        (union
#         (translateZ+ (translateZ+ (translateX+ (translateY+ a))))
#         (union
#          (union (translateY- (translateZ+ a)) (translateX- (translateZ+ a)))
#          (translateY+ (translateX+ (translateZ+ a)))))
#        (translateZ+
#         (translateX+ (translateX+ (translateZ+ (translateZ+ a))))))))
#     (translateZ+
#      (union
#       (union
#        (union
#         (translateY+ (translateY+ (translateZ+ (translateZ+ a))))
#         (union
#          (translateX- (translateX- (translateZ+ a)))
#          (diff (translateZ+ (translateX+ a)) (translateY- (translateZ+ a)))))
#        (union
#         (translateX+ (translateZ+ (translateY- (translateZ+ a))))
#         (diff
#          (translateY+ (translateZ+ (translateZ+ a)))
#          (translateX- (translateX- (translateZ+ a))))))
#       (union
#        (translateZ+ (translateY- (translateZ+ (translateX- (translateZ+ a)))))
#        (translateX-
#         (translateZ+ (translateZ+ (translateY+ (translateY+ a))))))))))
panel_2 = Panel("""(union (union
     (translateX+ (translateY+ (translateZ+ a)))
     (translateY+ (union (translateZ+ a) a)))
    (union
     (translateX+ (union a (translateZ+ a)))
     (union (translateY+ (translateX+ a)) (union (translateZ+ a) a)))))""")
number_slider = Slider(1, range=0..1)
box22 = Panel("0000 0000 0033 0033")
tetrominoes = Panel("0990 6002 4006 0990")
mirrorbox = Panel("9009 0640 0260 9009")
_3planes = Panel("9009000000009009")
pt = ConstructPoint(XCoordinate=0, YCoordinate=0, ZCoordinate=0)
pt_2 = ConstructPoint(XCoordinate=number_slider, YCoordinate=number_slider, ZCoordinate=number_slider)
box = Box2Pt(PointA=pt, PointB=pt_2, Plane=PlaneXY(0, 0, 0))
c_script = CSharpScript(x=panel, a=box)  # -> out, A, B, C, D, E; inputs x: String, a: Box
# ---------- c_script: C# ----------
    // Rhino.RhinoApp.Write("Parsing\n");
    var vx = mk_vx(x);

    //   Rhino.RhinoApp.Write("Condensing\n");
    var result = collapse(vx);
    A = result.Print();

    result.SetBoxes();
    var bbox = new BoundingBox(result.boxes.SelectMany(p => new Point3d[]{p.GetCorners()[0],p.GetCorners()[6]}));
    var offset = (Vector3d) bbox.Center;
    var skeleton = new List<Line>();
    for (var k = bbox.Min.Z; k <= bbox.Max.Z; k++) {
      for (var j = bbox.Min.Y; j <= bbox.Max.Y; j++) {
        skeleton.Add(new Line(new Point3d(bbox.Min.X, j, k), new Point3d(bbox.Max.X, j, k)));
      }
      for (var i = bbox.Min.X; i <= bbox.Max.X; i++) {
        skeleton.Add(new Line(new Point3d(i, bbox.Min.Y, k), new Point3d(i, bbox.Max.Y, k)));
      }
    }
    for (var j = bbox.Min.Y; j <= bbox.Max.Y; j++) {
      for (var i = bbox.Min.X; i <= bbox.Max.X; i++) {
        skeleton.Add(new Line(new Point3d(i, j, bbox.Min.Z), new Point3d(i, j, bbox.Max.Z)));
      }
    }
    setSizes(result, result.width / 2, result.height);
    //    Rhino.RhinoApp.Write("Flattening\n");

    var tree = new DataTree<Box>();
    var arr = new List<Line>();
    var lbl = new List<string>();
    var bases = new List<Point3d>();


    flatten(tree, arr, lbl, bases, result, offset);
    A = tree;
    B = arr;
    C = lbl;
    D = bases;
    E = skeleton;
# ---------- c_script: C# additional code ----------
  public enum Op {
    Union = 0,
    Diff = 1,
    XP = 2,
    XN = 3,
    YP = 4,
    YN = 5,
    ZP = 6,
    ZN = 7,
    MX = 8,
    MY = 9,
    MZ = 10,
    Base = 11
  }

  public struct VxNode {
    public Op op_type;
    public List<VxNode> args;

    public VxNode(Op op, List<VxNode> in_args) {
      op_type = op;
      args = in_args;
    }

    public string Print() {
      var sub = string.Join(" ", this.args.Select(i => i.Print()).ToArray());
      return string.Join(" ", new string[] {"[", this.op_type.ToString(), sub, "]"});
    }
  }

  void setSizes(BoxNode node, int x, int depth) {
    var z = depth * 5;
    node.SetPosition(new Vector3d(x, 0, z));
    switch (node.op_type) {
      case Op.Union:
      case Op.Diff:
        var x1 = x - node.args[0].RightWidth();
        setSizes(node.args[0], x1, depth - 1);
        var x2 = x + node.args[1].LeftWidth();
        setSizes(node.args[1], x2, depth - 1);
        break;
      case Op.Base:
        return;
      default:
        setSizes(node.args[0], x, depth - 1);
        return;
    }
  }

  static ulong mirrorX(ulong x) {
    return (x & 0x3333333333333333) | ((x & 0x2222222222222222) << 1) | ((x & 0x1111111111111111) << 3);
  }


  static ulong mirrorY(ulong x) {
    ulong b1 = (x & 0x00FF00FF00FF00FF) << 8;
    ulong b2 = ((b1 & 0x0F0F0F0F0F0F0F0F) << 4) | ((b1 & 0xF0F0F0F0F0F0F0F0) >> 4);
    ulong b3 = ((b2 & 0x3333333333333333) << 2) | ((b2 & 0xCCCCCCCCCCCCCCCC) >> 2);
    ulong b4 = ((b3 & 0x5555555555555555) << 1) | ((b3 & 0xAAAAAAAAAAAAAAAA) >> 1);
    return (b4 & 0xFF00FF00FF00FF00) | (x & 0x00FF00FF00FF00FF);
  }

  static ulong mirrorZ(ulong x) {
    ulong b1 = (x & 0x00000000FFFFFFFF) << 32;
    ulong b2 = ((b1 & 0x0000FFFF00000000) << 16) | ((b1 & 0xFFFF000000000000) >> 16);
    ulong b3 = ((b2 & 0x00FF00FF00000000) << 8 ) | ((b2 & 0xFF00FF0000000000) >> 8 );
    ulong b4 = ((b3 & 0x0F0F0F0F00000000) << 4 ) | ((b3 & 0xF0F0F0F000000000) >> 4 );
    ulong b5 = ((b4 & 0x3333333300000000) << 2 ) | ((b4 & 0xCCCCCCCC00000000) >> 2 );
    ulong b6 = ((b5 & 0x5555555500000000) << 1 ) | ((b5 & 0xAAAAAAAA00000000) >> 1 );
    return b6 | (x & 0x00000000FFFFFFFF);
  }


  static Box moveBox(Box box, Vector3d v) {
    var corners = box.GetCorners();
    var c1 = corners[0]; var c2 = corners[6];
    return new Box(new BoundingBox(c1 + v, c2 + v));
  }

  public class BoxNode {
    public Op op_type;
    public List<Box> boxes;
    public ulong data;
    public List<BoxNode> args;
    public int height;
    public int width;
    public Point3d basePt;

    public BoxNode(Op op, List<BoxNode> in_args, ulong in_data) {
      // RhinoApp.WriteLine(op.ToString() + " " + in_data.ToString());
      op_type = op;
      args = in_args;
      data = in_data;
      height = 0;
      width = 6;
      boxes = new List<Box>();
      basePt = new Point3d(0, 0, 0);
      if (op == Op.Base) return;
      foreach (var arg in in_args) {
        height = Math.Max(height, arg.height);
      }
      height += 1;
      if (op == Op.Union || op == Op.Diff) {
        foreach (var arg in in_args) {
          width += arg.width;
        }
      } else {
        width = args[0].width;
      }
    }

    public void SetBoxes() {
      for (var k = 0; k < 4; k++) {
        for (var j = 0; j < 4; j++) {
          for (var i = 0; i < 4; i++) {
            ulong mask = 0x8000000000000000 >> ((k * 16) + (j * 4) + i);
            if ((data & mask) != 0) {
              boxes.Add(new Box(new BoundingBox(new Point3d(i, j, k), new Point3d(i + 1, j + 1, k + 1))));
            }
          }
        }
      }

      foreach (var arg in args) {
        arg.SetBoxes();
      }
    }

    public string Print() {
      var sub = string.Join(" ", this.args.Select(i => i.Print()).ToArray());
      return string.Join(" ", new string[] {"[", this.op_type.ToString(), sub, data.ToString(), "]"});
    }

    public void SetPosition(Vector3d v) {
      basePt = new Point3d(v.X, v.Y, v.Z);
      for (var i = 0; i < boxes.Count; i++) {
        boxes[i] = moveBox(boxes[i], v);
      }
    }

    public int RightWidth() {
      switch (op_type) {
        case Op.Union:
        case Op.Diff:
          return args[1].width / 2;
        default:
          return width / 2;
      }
    }

    public int LeftWidth() {
      switch (op_type) {
        case Op.Union:
        case Op.Diff:
          return args[0].width / 2;
        default:
          return width / 2;
      }
    }
  }

  Op op_type(string op) {
    op = op.Trim();
    if (op == "union") return Op.Union;
    if (op == "diff") return Op.Diff;
    if (op == "translateX+") return Op.XP;
    if (op == "translateX-") return Op.XN;
    if (op == "translateY+") return Op.YP;
    if (op == "translateY-") return Op.YN;
    if (op == "translateZ+") return Op.ZP;
    if (op == "translateZ-") return Op.ZN;
    if (op == "mirrorX") return Op.MX;
    if (op == "mirrorY") return Op.MY;
    if (op == "mirrorZ") return Op.MZ;
    return Op.Base;
  }

  string get_balanced(string ss, int i) {
    //  Rhino.RhinoApp.Write("<b>" + ss + "</b>(" + i.ToString() + ")");
    var start = i;
    if (ss[i] == '(') {
      var bal = 1; i++;
      while (bal != 0) {
        if (ss[i] == '(') bal++;
        if (ss[i] == ')') bal--;
        i++;
      }
      var end = i;
      var result = ss.Substring(start, end - start);
      // Rhino.RhinoApp.Write(" => \"" + result + "\" \n");
      return result;
    } else {
      while (i < ss.Length && !Char.IsWhiteSpace(ss, i)) i++;
      var end = i;
      var result = ss.Substring(start, end - start);
      // Rhino.RhinoApp.Write(" => \"" + result + "\" \n");
      return result;
    }
  }

  VxNode mk_vx(string input) {
    var ss = input.Trim();
    if (ss.Length > 2 && ss[0] == '(' && ss[ss.Length - 1] == ')') {
      ss = ss.Substring(1, ss.Length - 2);
    }
    var i = 0;
    while (i < ss.Length && !Char.IsWhiteSpace(ss, i)) i++;
    Op op = op_type(ss.Substring(0, i));
    Rhino.RhinoApp.Write(op.ToString() + "\n");
    if (op == Op.Base) {
      return new VxNode(op, new List<VxNode>());
    }

    while (Char.IsWhiteSpace(ss, i)) i++;
    if (op == Op.Diff || op == Op.Union) {
      var a1 = get_balanced(ss, i);
      i += a1.Length;
      while (Char.IsWhiteSpace(ss, i)) i++;
      var a2 = get_balanced(ss, i);
      var v1 = mk_vx(a1);
      var v2 = mk_vx(a2);
      return new VxNode(op, new List<VxNode>{v1,v2});
    }
    var a = get_balanced(ss, i);
    var v = mk_vx(a);
    return new VxNode(op, new List<VxNode>{v});
  }

  BoxNode combine(VxNode input) {
    if (input.op_type == Op.Base || input.op_type == Op.Union || input.op_type == Op.Diff ||
    input.op_type == Op.MX || input.op_type == Op.MY || input.op_type == Op.MZ) {
      return collapse(input);
    } else {
      var c = combine(input.args[0]);

      switch (input.op_type) {
        case Op.XN: c.data = c.data >> 1; break;
        case Op.XP: c.data = c.data << 1; break;
        case Op.YN: c.data = c.data >> 4; break;
        case Op.YP: c.data = c.data << 4; break;
        case Op.ZN: c.data = c.data >> 16; break;
        case Op.ZP: c.data = c.data << 16; break;
      }

      return c;
    }
  }

  BoxNode collapse(VxNode input) {
    if (input.op_type == Op.Base) {
      return new BoxNode(Op.Base, new List<BoxNode>(), 0x0000000000000001);
    }
    if (input.op_type == Op.Diff) {
      var c1 = collapse(input.args[0]);
      var c2 = collapse(input.args[1]);
      return new BoxNode(Op.Diff, new List<BoxNode>(){c1,c2}, c1.data & (~c2.data));
    }
    if (input.op_type == Op.Union) {
      var c1 = collapse(input.args[0]);
      var c2 = collapse(input.args[1]);
      return new BoxNode(Op.Union, new List<BoxNode>(){c1,c2}, c1.data | c2.data);
    }
    if (input.op_type == Op.MX) {
      var c = collapse(input.args[0]);
      return new BoxNode(Op.MX, new List<BoxNode>(){c}, mirrorX(c.data));
    }
    if (input.op_type == Op.MY) {
      var c = collapse(input.args[0]);
      return new BoxNode(Op.MY, new List<BoxNode>(){c}, mirrorY(c.data));
    }
    if (input.op_type == Op.MZ) {
      var c = collapse(input.args[0]);
      return new BoxNode(Op.MZ, new List<BoxNode>(){c}, mirrorZ(c.data));
    }
    return combine(input);
  }

  void flatten(
    DataTree<Box> tree,
    List<Line> arr,
    List<string> lbl,
    List<Point3d> bases,
    BoxNode node,
  Vector3d offset) {

    if (node.op_type == Op.Base) {
      var p = tree.BranchCount;
      if (node.boxes.Count > 0) {
        tree.Add(node.boxes[0], new GH_Path(p));
      }
    }
    if (node.op_type == Op.Union || node.op_type == Op.Diff) {
      flatten(tree, arr, lbl, bases, node.args[0], offset);
      flatten(tree, arr, lbl, bases, node.args[1], offset);
      var p = tree.BranchCount;
      tree.AddRange(node.boxes, new GH_Path(p));
    }
    if (node.op_type == Op.MX || node.op_type == Op.MY || node.op_type == Op.MZ) {
      flatten(tree, arr, lbl, bases, node.args[0], offset);
      var p = tree.BranchCount;
      tree.AddRange(node.boxes, new GH_Path(p));
    }

    foreach (var arg in node.args) {
      var l = new Line(node.basePt + offset, arg.basePt + offset);
      arr.Add(l);
      bases.Add(node.basePt + offset);
      lbl.Add(node.op_type.ToString());
    }
  }
# ---------- end c_script ----------
c_script_2 = CSharpScript(len=Slider(4, range=0..10))  # -> out, A; inputs len: Int32
# ---------- c_script_2: C# ----------
    var result = new List<Box>();
    for (var k = 0; k < len; k++) {
      for (var j = 0; j < len; j++) {
        for (var i = 0; i < len; i++) {
          var p1 = new Point3d((double) i, (double) j, (double) k);
          var p2 = new Point3d((double) i + 1, (double) j + 1, (double) k + 1);
          result.Add(new Box(new BoundingBox(p1, p2)));
        }
      }
    }
    A = result;
# ---------- end c_script_2 ----------
c_script_3 = CSharpScript(hex=_3planes)  # -> out, A; inputs hex: String
# ---------- c_script_3: C# ----------
    hex = hex.Replace(" ", "");
    hex = hex.Replace("0x", "");
    var str = String.Join(String.Empty,
      hex.Select(c => Convert.ToString(Convert.ToInt32(c.ToString(), 16), 2).PadLeft(4, '0')));
    var bools = new List<bool>();
    foreach (var c in str) {
      if (c == '0') bools.Add(false);
      if (c == '1') bools.Add(true);
    }
    A = bools;
# ---------- end c_script_3 ----------
c_script_4 = CSharpScript(x=panel_2, a=box)  # -> out, A, B, C, D, E; inputs x: String, a: Box
# ---------- c_script_4: C# ----------
    Rhino.RhinoApp.Write("Parsing\n");
    var vx = mk_vx(x);
    A = vx.Print();
    //   Rhino.RhinoApp.Write("Condensing\n");
    var result = collapse(vx);
  
    result.SetBoxes();  
    var bbox = new BoundingBox(result.boxes.SelectMany(p => new Point3d[]{p.GetCorners()[0],p.GetCorners()[6]}));
    var offset = (Vector3d) bbox.Center;
    var skeleton = new List<Line>();
    for (var k = bbox.Min.Z; k <= bbox.Max.Z; k++) {
      for (var j = bbox.Min.Y; j <= bbox.Max.Y; j++) {
        skeleton.Add(new Line(new Point3d(bbox.Min.X, j, k), new Point3d(bbox.Max.X, j, k)));
      }
      for (var i = bbox.Min.X; i <= bbox.Max.X; i++) {
        skeleton.Add(new Line(new Point3d(i, bbox.Min.Y, k), new Point3d(i, bbox.Max.Y, k)));
      }
    }
    for (var j = bbox.Min.Y; j <= bbox.Max.Y; j++) {
      for (var i = bbox.Min.X; i <= bbox.Max.X; i++) {
        skeleton.Add(new Line(new Point3d(i, j, bbox.Min.Z), new Point3d(i, j, bbox.Max.Z)));
      }
    }
    setSizes(result, result.width / 2, result.height);
    //    Rhino.RhinoApp.Write("Flattening\n");

    var tree = new DataTree<Box>();
    var arr = new List<Line>();
    var lbl = new List<string>();
    var bases = new List<Point3d>();


    flatten(tree, arr, lbl, bases, result, offset);
    A = tree;
    B = arr;
    C = lbl;
    D = bases;
    E = skeleton;
# ---------- c_script_4: C# additional code ----------
  public enum Op {
    Union = 0,
    Diff = 1,
    XP = 2,
    XN = 3,
    YP = 4,
    YN = 5,
    ZP = 6,
    ZN = 7,
    Base = 8
  }

  public struct VxNode {
    public Op op_type;
    public List<VxNode> args;

    public VxNode(Op op, List<VxNode> in_args) {
      op_type = op;
      args = in_args;
    }

    public string Print() {
      var sub = string.Join(" ", this.args.Select(i => i.Print()).ToArray());
      return string.Join(" ", new string[] {"[", this.op_type.ToString(), sub, "]"});
    }
  }

  void setSizes(BoxNode node, int x, int depth) {
    var z = depth * 4;
    node.SetPosition(new Vector3d(x, 0, z));
    switch (node.op_type) {
      case Op.Union:
      case Op.Diff:
        var x1 = x - node.args[0].RightWidth();
        setSizes(node.args[0], x1, depth - 1);
        var x2 = x + node.args[1].LeftWidth();
        setSizes(node.args[1], x2, depth - 1);
        break;
      case Op.Base:
        return;
      default:
        setSizes(node.args[0], x, depth - 1);
        return;
    }
  }

  static Box moveBox(Box box, Vector3d v) {
    var corners = box.GetCorners();
    var c1 = corners[0]; var c2 = corners[6];
    return new Box(new BoundingBox(c1 + v, c2 + v));
  }

  public class BoxNode {
    public Op op_type;
    public List<Box> boxes;
    public ulong data;
    public List<BoxNode> args;
    public int height;
    public int width;
    public Point3d basePt;

    public BoxNode(Op op, List<BoxNode> in_args, ulong in_data) {
      // RhinoApp.WriteLine(op.ToString() + " " + in_data.ToString());
      op_type = op;
      args = in_args;
      data = in_data;
      height = 0;
      width = 4;
      boxes = new List<Box>();
      basePt = new Point3d(0, 0, 0);
      if (op == Op.Base) return;
      foreach (var arg in in_args) {
        height = Math.Max(height, arg.height);
      }
      height += 1;
      if (op == Op.Union || op == Op.Diff) {
        foreach (var arg in in_args) {
          width += arg.width;
        }
      } else {
        width = args[0].width;
      }
    }

    public void SetBoxes() { 
      for (var k = 0; k < 4; k++) {
        for (var j = 0; j < 4; j++) {
          for (var i = 0; i < 4; i++) {
            ulong mask = 0x8000000000000000 >> ((k * 16) + (j * 4) + i);
            if ((data & mask) != 0) {
              boxes.Add(new Box(new BoundingBox(new Point3d(i, j, k), new Point3d(i + 1, j + 1, k + 1))));
            }
          }
        }
      }
      
      foreach (var arg in args) {
        arg.SetBoxes();
      }
    }
    
    public void SetPosition(Vector3d v) {
      basePt = new Point3d(v.X, v.Y, v.Z);
      for (var i = 0; i < boxes.Count; i++) {
        boxes[i] = moveBox(boxes[i], v);
      }
    }

    public int RightWidth() {
      switch (op_type) {
        case Op.Union:
        case Op.Diff:
          return args[1].width;
        default:
          return width / 2;
      }
    }

    public int LeftWidth() {
      switch (op_type) {
        case Op.Union:
        case Op.Diff:
          return args[0].width;
        default:
          return width / 2;
      }
    }
  }

  Op op_type(string op) {
    op = op.Trim();
    if (op == "union") return Op.Union;
    if (op == "diff") return Op.Diff;
    if (op == "translateX+") return Op.XP;
    if (op == "translateX-") return Op.XN;
    if (op == "translateY+") return Op.YP;
    if (op == "translateY-") return Op.YN;
    if (op == "translateZ+") return Op.ZP;
    if (op == "translateZ-") return Op.ZN;
    return Op.Base;
  }

  string get_balanced(string ss, int i) {
    //  Rhino.RhinoApp.Write("<b>" + ss + "</b>(" + i.ToString() + ")");
    var start = i;
    if (ss[i] == '(') {
      var bal = 1; i++;
      while (bal != 0) {
        if (ss[i] == '(') bal++;
        if (ss[i] == ')') bal--;
        i++;
      }
      var end = i;
      var result = ss.Substring(start, end - start);
      // Rhino.RhinoApp.Write(" => \"" + result + "\" \n");
      return result;
    } else {
      while (i < ss.Length && !Char.IsWhiteSpace(ss, i)) i++;
      var end = i;
      var result = ss.Substring(start, end - start);
      // Rhino.RhinoApp.Write(" => \"" + result + "\" \n");
      return result;
    }
  }

  VxNode mk_vx(string input) {
    var ss = input.Trim();
    if (ss.Length > 2 && ss[0] == '(' && ss[ss.Length - 1] == ')') {
      ss = ss.Substring(1, ss.Length - 2);
    }
    var i = 0;
    while (i < ss.Length && !Char.IsWhiteSpace(ss, i)) i++;
    Op op = op_type(ss.Substring(0, i));
    // Rhino.RhinoApp.Write(op.ToString() + "\n");
    if (op == Op.Base) {
      return new VxNode(op, new List<VxNode>());
    }

    while (Char.IsWhiteSpace(ss, i)) i++;
    if (op == Op.Diff || op == Op.Union) {
      var a1 = get_balanced(ss, i);
      i += a1.Length;
      while (Char.IsWhiteSpace(ss, i)) i++;
      var a2 = get_balanced(ss, i);
      var v1 = mk_vx(a1);
      var v2 = mk_vx(a2);
      return new VxNode(op, new List<VxNode>{v1,v2});
    }
    var a = get_balanced(ss, i);
    var v = mk_vx(a);
    return new VxNode(op, new List<VxNode>{v});
  }

  BoxNode combine(VxNode input) {
    if (input.op_type == Op.Base || input.op_type == Op.Union || input.op_type == Op.Diff) {
      return collapse(input);
    } else {
      var c = combine(input.args[0]);

      switch (input.op_type) {
        case Op.XN: c.data = c.data >> 1; break;
        case Op.XP: c.data = c.data << 1; break;
        case Op.YN: c.data = c.data >> 4; break;
        case Op.YP: c.data = c.data << 4; break;
        case Op.ZN: c.data = c.data >> 16; break;
        case Op.ZP: c.data = c.data << 16; break;
      }

      return c;
    }
  }

  BoxNode collapse(VxNode input) {
    if (input.op_type == Op.Base) {
      return new BoxNode(Op.Base, new List<BoxNode>(), 0x0000000000000001);
    }
    if (input.op_type == Op.Diff) {
      var c1 = collapse(input.args[0]);
      var c2 = collapse(input.args[1]);
      return new BoxNode(Op.Diff, new List<BoxNode>(){c1,c2}, c1.data & (~c2.data));
    }
    if (input.op_type == Op.Union) {
      var c1 = collapse(input.args[0]);
      var c2 = collapse(input.args[1]);
      return new BoxNode(Op.Union, new List<BoxNode>(){c1,c2}, c1.data | c2.data);
    }
    return combine(input);
  }

  void flatten(
    DataTree<Box> tree,
    List<Line> arr,
    List<string> lbl,
    List<Point3d> bases,
    BoxNode node,
  Vector3d offset) {

    if (node.op_type == Op.Base) {
      var p = tree.BranchCount;
      if (node.boxes.Count > 0) {
        tree.Add(node.boxes[0], new GH_Path(p));
      }
    }
    if (node.op_type == Op.Union || node.op_type == Op.Diff) {
      flatten(tree, arr, lbl, bases, node.args[0], offset);
      flatten(tree, arr, lbl, bases, node.args[1], offset);
      var p = tree.BranchCount;
      tree.AddRange(node.boxes, new GH_Path(p));
    }

    foreach (var arg in node.args) {
      var l = new Line(node.basePt + offset, arg.basePt + offset);
      arr.Add(l);
      bases.Add(node.basePt + offset);
      lbl.Add(node.op_type.ToString());
    }
  }
# ---------- end c_script_4 ----------
old = CSharpScript(x=panel_2, a=box)  # -> out, A, B, C, D, E; inputs x: String, a: Box
# ---------- old: C# ----------
    Rhino.RhinoApp.Write("Parsing\n");
    var vx = mk_vx(x);
    A = vx.Print();
    //   Rhino.RhinoApp.Write("Condensing\n");
    var result = collapse(vx, a);

    var bbox = new BoundingBox(result.boxes.SelectMany(p => new Point3d[]{p.GetCorners()[0],p.GetCorners()[6]}));
    var offset = (Vector3d) bbox.Center;
    var skeleton = new List<Line>();
    for (var k = bbox.Min.Z; k <= bbox.Max.Z; k++) {
      for (var j = bbox.Min.Y; j <= bbox.Max.Y; j++) {
        skeleton.Add(new Line(new Point3d(bbox.Min.X, j, k), new Point3d(bbox.Max.X, j, k)));
      }
      for (var i = bbox.Min.X; i <= bbox.Max.X; i++) {
        skeleton.Add(new Line(new Point3d(i, bbox.Min.Y, k), new Point3d(i, bbox.Max.Y, k)));
      }
    }
    for (var j = bbox.Min.Y; j <= bbox.Max.Y; j++) {
      for (var i = bbox.Min.X; i <= bbox.Max.X; i++) {
        skeleton.Add(new Line(new Point3d(i, j, bbox.Min.Z), new Point3d(i, j, bbox.Max.Z)));
      }
    }


    setSizes(result, result.width / 2, result.height);
    //    Rhino.RhinoApp.Write("Flattening\n");

    var tree = new DataTree<Box>();
    var arr = new List<Line>();
    var lbl = new List<string>();
    var bases = new List<Point3d>();


    flatten(tree, arr, lbl, bases, result, offset);
    A = tree;
    B = arr;
    C = lbl;
    D = bases;
    E = skeleton;
# ---------- old: C# additional code ----------
  public enum Op {
    Union = 0,
    Diff = 1,
    XP = 2,
    XN = 3,
    YP = 4,
    YN = 5,
    ZP = 6,
    ZN = 7,
    Base = 8
  }

  public struct VxNode {
    public Op op_type;
    public List<VxNode> args;

    public VxNode(Op op, List<VxNode> in_args) {
      op_type = op;
      args = in_args;
    }

    public string Print() {
      var sub = string.Join(" ", this.args.Select(i => i.Print()).ToArray());
      return string.Join(" ", new string[] {"[", this.op_type.ToString(), sub, "]"});
    }
  }

  void setSizes(BoxNode node, int x, int depth) {
    var z = depth * 4;
    node.SetPosition(new Vector3d(x, 0, z));
    switch (node.op_type) {
      case Op.Union:
      case Op.Diff:
        var x1 = x - node.args[0].RightWidth();
        setSizes(node.args[0], x1, depth - 1);
        var x2 = x + node.args[1].LeftWidth();
        setSizes(node.args[1], x2, depth - 1);
        break;
      case Op.Base:
        return;
      default:
        setSizes(node.args[0], x, depth - 1);
        return;
    }
  }

  static Box moveBox(Box box, Vector3d v) {
    var corners = box.GetCorners();
    var c1 = corners[0]; var c2 = corners[6];
    return new Box(new BoundingBox(c1 + v, c2 + v));
  }

  public class BoxNode {
    public Op op_type;
    public List<Box> boxes;
    public List<BoxNode> args;
    public int height;
    public int width;
    public Point3d basePt;

    public BoxNode(Op op, List<BoxNode> in_args, List<Box> in_boxes) {
      op_type = op;
      args = in_args;
      boxes = in_boxes;
      height = 0;
      width = 4;
      basePt = new Point3d(0, 0, 0);
      if (op == Op.Base) return;
      foreach (var arg in in_args) {
        height = Math.Max(height, arg.height);
      }
      height += 1;
      if (op == Op.Union || op == Op.Diff) {
        foreach (var arg in in_args) {
          width += arg.width;
        }
      } else {
        width = args[0].width;
      }
    }

    public void SetPosition(Vector3d v) {
      this.basePt = new Point3d(v.X, v.Y, v.Z);
      // Rhino.RhinoApp.WriteLine(basePt.ToString());
      for (var i = 0; i < boxes.Count; i++) {
        boxes[i] = moveBox(boxes[i], v);
      }
    }

    public int RightWidth() {
      switch (op_type) {
        case Op.Union:
        case Op.Diff:
          return args[1].width;
        default:
          return width / 2;
      }
    }

    public int LeftWidth() {
      switch (op_type) {
        case Op.Union:
        case Op.Diff:
          return args[0].width;
        default:
          return width / 2;
      }
    }
  }

  Op op_type(string op) {
    op = op.Trim();
    if (op == "union") return Op.Union;
    if (op == "diff") return Op.Diff;
    if (op == "translateX+") return Op.XP;
    if (op == "translateX-") return Op.XN;
    if (op == "translateY+") return Op.YP;
    if (op == "translateY-") return Op.YN;
    if (op == "translateZ+") return Op.ZP;
    if (op == "translateZ-") return Op.ZN;
    return Op.Base;
  }

  string get_balanced(string ss, int i) {
    //  Rhino.RhinoApp.Write("<b>" + ss + "</b>(" + i.ToString() + ")");
    var start = i;
    if (ss[i] == '(') {
      var bal = 1; i++;
      while (bal != 0) {
        if (ss[i] == '(') bal++;
        if (ss[i] == ')') bal--;
        i++;
      }
      var end = i;
      var result = ss.Substring(start, end - start);
      // Rhino.RhinoApp.Write(" => \"" + result + "\" \n");
      return result;
    } else {
      while (i < ss.Length && !Char.IsWhiteSpace(ss, i)) i++;
      var end = i;
      var result = ss.Substring(start, end - start);
      // Rhino.RhinoApp.Write(" => \"" + result + "\" \n");
      return result;
    }
  }

  VxNode mk_vx(string input) {
    var ss = input.Trim();
    if (ss.Length > 2 && ss[0] == '(' && ss[ss.Length - 1] == ')') {
      ss = ss.Substring(1, ss.Length - 2);
    }
    var i = 0;
    while (i < ss.Length && !Char.IsWhiteSpace(ss, i)) i++;
    Op op = op_type(ss.Substring(0, i));
    // Rhino.RhinoApp.Write(op.ToString() + "\n");
    if (op == Op.Base) {
      return new VxNode(op, new List<VxNode>());
    }

    while (Char.IsWhiteSpace(ss, i)) i++;
    if (op == Op.Diff || op == Op.Union) {
      var a1 = get_balanced(ss, i);
      i += a1.Length;
      while (Char.IsWhiteSpace(ss, i)) i++;
      var a2 = get_balanced(ss, i);
      var v1 = mk_vx(a1);
      var v2 = mk_vx(a2);
      return new VxNode(op, new List<VxNode>{v1,v2});
    }
    var a = get_balanced(ss, i);
    var v = mk_vx(a);
    return new VxNode(op, new List<VxNode>{v});
  }

  BoxNode combine(VxNode input, Box a) {
    if (input.op_type == Op.Base || input.op_type == Op.Union || input.op_type == Op.Diff) {
      return collapse(input, a);
    } else {
      var c = combine(input.args[0], a);
      var v = new Vector3d(0, 0, 0);
      switch (input.op_type) {
        case Op.XN: v = new Vector3d(-1, 0, 0); break;
        case Op.XP: v = new Vector3d(1, 0, 0); break;
        case Op.YN: v = new Vector3d(0, -1, 0); break;
        case Op.YP: v = new Vector3d(0, 1, 0); break;
        case Op.ZN: v = new Vector3d(0, 0, -1); break;
        case Op.ZP: v = new Vector3d(0, 0, 1); break;
      }
      var t = Rhino.Geometry.Transform.Translation(v);
      for (var i = 0; i < c.boxes.Count; i++) {
        c.boxes[i] = moveBox(c.boxes[i], v);
      }
      return c;
    }
  }

  BoxNode collapse(VxNode input, Box a) {
    if (input.op_type == Op.Base) {
      return new BoxNode(Op.Base, new List<BoxNode>(), new List<Box>(){ new Box(a.BoundingBox) });
    }
    if (input.op_type == Op.Diff) {
      var c1 = collapse(input.args[0], a);
      var c2 = collapse(input.args[1], a);
      var new_boxes = new List<Box>();
      foreach (var box in c1.boxes) {
        bool rm = false;
        foreach (var cbox in c2.boxes) {
          if (cbox.EpsilonEquals(box, 0.01)) {
            rm = true;
          }
        }
        if (!rm) {
          new_boxes.Add(new Box(box.BoundingBox));
        }
      }
      return new BoxNode(Op.Diff, new List<BoxNode>(){c1,c2}, new_boxes);
    }
    if (input.op_type == Op.Union) {
      var c1 = collapse(input.args[0], a);
      var c2 = collapse(input.args[1], a);
      var new_boxes = new List<Box>();
      foreach (var box in c1.boxes) {
        new_boxes.Add(new Box(box.BoundingBox));
      }
      foreach (var box in c2.boxes) {
        bool rm = false;
        foreach (var cbox in c1.boxes) {
          if (cbox.EpsilonEquals(box, 0.01)) {
            rm = true;
          }
        }
        if (!rm) {
          new_boxes.Add(new Box(box.BoundingBox));
        }
      }
      return new BoxNode(Op.Union, new List<BoxNode>(){c1,c2}, new_boxes);
    }
    return combine(input, a);
  }

  void flatten(
    DataTree<Box> tree,
    List<Line> arr,
    List<string> lbl,
    List<Point3d> bases,
    BoxNode node,
  Vector3d offset) {

    if (node.op_type == Op.Base) {
      var p = tree.BranchCount;
      tree.Add(node.boxes[0], new GH_Path(p));
    }
    if (node.op_type == Op.Union || node.op_type == Op.Diff) {
      flatten(tree, arr, lbl, bases, node.args[0], offset);
      flatten(tree, arr, lbl, bases, node.args[1], offset);
      var p = tree.BranchCount;
      tree.AddRange(node.boxes, new GH_Path(p));
    }

    foreach (var arg in node.args) {
      var l = new Line(node.basePt + offset, arg.basePt + offset);
      arr.Add(l);
      bases.Add(node.basePt + offset);
      lbl.Add(node.op_type.ToString());
    }
  }
# ---------- end old ----------
group = Group(Objects=c_script.E)
bbox = BoundingBox(Content=group, Plane=PlaneXY(0, 0, 0))  # -> Box, Box_2
group_2 = Group(Objects=c_script_4.E)
cull = CullPattern(List=c_script_2.A, CullPattern=[False, False, True, True])
cull_2 = CullPattern(List=c_script_2.A, CullPattern=c_script_3.A)
boxprop = BoxProperties(Box=bbox.Box)  # -> Center, Diagonal, Area, Volume, Degeneracy
bbox_2 = BoundingBox(Content=group_2, Plane=PlaneXY(0, 0, 0))  # -> Box, Box_2
boxprop_2 = BoxProperties(Box=bbox_2.Box)  # -> Center, Diagonal, Area, Volume, Degeneracy
screentext = ScreenOrientedText(
    Text=c_script.C,
    Justification=5,
    Location=c_script.D,
    SizeFactor=Slider(0.52, range=0.01..100),
    Depth=0,
    Absolute=invert(False))
screentext_2 = ScreenOrientedText(
    Text=c_script_4.C,
    Justification=5,
    Location=c_script_4.D,
    SizeFactor=Slider(0.52, range=0.01..100),
    Depth=0,
    Absolute=invert(False))

box_2 = Box(c_script_4.A)
line = Line(c_script_4.B)

end = EndPoints(Curve=line)  # -> Start, End
cullpt = CullDuplicates(Points=[end.Start, end.End], Tolerance=0.1, CullMode=1)  # -> Points, Indices, Valence
subtraction = Subtraction(A=cullpt.Points, B=boxprop_2.Center)

move = Move(Geometry=group_2, Motion=subtraction)  # -> Geometry, Transform

line_2 = Line(c_script.B)
box_3 = Box(c_script.A)

end_2 = EndPoints(Curve=line_2)  # -> Start, End
cullpt_2 = CullDuplicates(Points=[end_2.Start, end_2.End], Tolerance=0.1, CullMode=1)  # -> Points, Indices, Valence
subtraction_2 = Subtraction(A=cullpt_2.Points, B=boxprop.Center)

move_2 = Move(Geometry=group, Motion=subtraction_2)  # -> Geometry, Transform

previewlw = CustomPreviewLineweights(Geometry=move_2.Geometry, Shader=ColourSwatch(SwatchColor=RGB(199, 199, 199)), Absolute=False)
